# Grasshopper definition NODEMaple Grasshopper.gh (Grasshopper 1.0.9)

timber_properties = Python3Script(material="C24", prop="f_m,k")  # -> out, value, unit, debug
# ---------- timber_properties: Python ----------
"""NODE-Timber-Materialabfrage, parametrisiert"""
import os, subprocess

MAPLE_PATH = r"C:\Program Files\Maple 2026\bin.X86_64_WINDOWS\cmaple.exe"
MAPLE_ROOT = r"C:\Program Files\Maple 2026"

def timber_property(material, prop):
    maple_dir = os.path.dirname(MAPLE_PATH)
    env = dict(os.environ)
    env["PATH"] = maple_dir + os.pathsep + env.get("PATH", "")
    env["MAPLE"] = MAPLE_ROOT

    script = (
        'with(NODETimberMaterial):\n'
        'kernelopts(printbytes=false):\n'
        'interface(prettyprint=0):\n'
        f'p := Property("{material}", "{prop}"):\n'
        'q := Units:-Split(p):\n'
        'printf("VALUE=%a\\n", evalf(q[1])):\n'
        'printf("UNIT=%a\\n", q[2]):\n'
        'quit:\n'
    )

    proc = subprocess.Popen(
        [MAPLE_PATH, "-q"],
        stdin=subprocess.PIPE, stdout=subprocess.PIPE,
        stderr=subprocess.STDOUT, text=True,
        cwd=maple_dir, env=env,
        creationflags=subprocess.CREATE_NO_WINDOW)

    out, _ = proc.communicate(input=script, timeout=20)
    return out

# ---- Eingaben ----
raw = timber_property(material, prop)

value = None
unit  = None
parsed = []                      # Diagnose: was wurde erkannt?

for line in raw.splitlines():
    s = line.strip()
    parsed.append(repr(s))        # Zeile 1:1 mit Sonderzeichen sichtbar
    if s.startswith("VALUE="):
        try:
            value = float(s.split("=", 1)[1])
            parsed.append(f"  -> value = {value!r}")
        except ValueError as e:
            parsed.append(f"  !! float-Fehler: {e}")
    elif s.startswith("UNIT="):
        unit = s.split("=", 1)[1]
        parsed.append(f"  -> unit = {unit!r}")

debug = "\n".join(parsed)
# ---------- end timber_properties ----------
panel = Panel(timber_properties.unit)
panel_2 = Panel(timber_properties.out)
panel_3 = Panel(timber_properties.value)
panel_4 = Panel(timber_properties.debug)
